# Grasshopper definition qodo_assignment1.gh (Grasshopper 1.0.8)

file_path = FilePath("D:\MPDA\PytHon\GitHub\MPDA25-Session04\qodo\assignment01.py")
read_file = ReadFile(File=file_path, PerLineParse=False)
panel = Panel(read_file)
python_3_script = Python3Script(script=read_file, x_points=Slider(40, range=0..100), y_points=Slider(50, range=0..100))  # -> out, a, b, c, d, e, f, g; inputs x_points: Int32; unedited script template
panel_2 = Panel(python_3_script.e)
point = Point(python_3_script.f)
panel_4 = Panel(python_3_script.b)
